# Dynamo graph unit data.dyn (Dynamo 0.9.0.3067)

string = StringInput("C:\Users\dklassen\Source\Repos\Dynamo-Unit Mix\sandbox\Yield Matrix.xlsx")
string_2 = StringInput("UnitSummary")
number = DoubleInput(0)
join = List.Join()
join_2 = List.Join()
string_3 = StringInput("FLOOR")
code_block = CodeBlock { null; }
number_2 = DoubleInput(6)
ofRepeatedItem = List.OfRepeatedItem(item=code_block, amount=number_2)
addItemToEnd = List.AddItemToEnd(string_3, ofRepeatedItem)
string_4 = StringInput("b.Unit Token")
byName = Family.ByName(string_4)
types = Family.Types(byName)
string_5 = StringInput("Matrix_Name")
getParameterValueByName = Element.GetParameterValueByName(element=types, parameterName=string_5)
sortByKey = SortByKey(types, getParameterValueByName)
all_elements_of_family_type = ElementsOfFamilyType(sortByKey)
string_6 = StringInput("Level")
getParameterValueByName_2 = Element.GetParameterValueByName(element=all_elements_of_family_type, parameterName=string_6)
string_7 = StringInput("Name")
getParameterValueByName_3 = Element.GetParameterValueByName(element=getParameterValueByName_2, parameterName=string_7)
flatten = Flatten(getParameterValueByName_3)
uniqueItems = List.UniqueItems(flatten)
sort = List.Sort(uniqueItems)
join_3 = List.Join(addItemToEnd, sort)
create = List.Create(join_3)
transpose = List.Transpose(create)
string_8 = StringInput("Type Comments")
getParameterValueByName_4 = Element.GetParameterValueByName(element=sortByKey, parameterName=string_8)
string_9 = StringInput("Project_Name")
getParameterValueByName_5 = Element.GetParameterValueByName(element=sortByKey, parameterName=string_9)
string_10 = StringInput("Area")
getParameterValueByName_6 = Element.GetParameterValueByName(element=sortByKey, parameterName=string_10)
string_11 = StringInput("Bedrooms")
getParameterValueByName_7 = Element.GetParameterValueByName(element=sortByKey, parameterName=string_11)
string_12 = StringInput("Baths")
getParameterValueByName_8 = Element.GetParameterValueByName(element=sortByKey, parameterName=string_12)
string_13 = StringInput("Den")
getParameterValueByName_9 = Element.GetParameterValueByName(element=sortByKey, parameterName=string_13)
string_14 = StringInput("Matrix_Name")
getParameterValueByName_10 = Element.GetParameterValueByName(element=sortByKey, parameterName=string_14)
create_2 = List.Create(getParameterValueByName_4, getParameterValueByName_5, getParameterValueByName_6, getParameterValueByName_7, getParameterValueByName_8, getParameterValueByName_9, getParameterValueByName_10)
allIndicesOf = List.AllIndicesOf(item=sort)
map = List.Map(list=getParameterValueByName_3, f_x=allIndicesOf)
count = List.Count()
map_2 = List.Map(f_x=count)
map_3 = List.Map(list=map, f_x=map_2)
transpose_2 = List.Transpose(map_3)
join_4 = List.Join(create_2, transpose_2)
combine = List.Combine(join_2, transpose, join_4)
string_15 = StringInput("TOTAL")
code_block_2 = CodeBlock { null; }
number_3 = DoubleInput(6)
ofRepeatedItem_2 = List.OfRepeatedItem(item=code_block_2, amount=number_3)
addItemToEnd_2 = List.AddItemToEnd(string_15, ofRepeatedItem_2)
sum = Math.Sum(transpose_2)
join_5 = List.Join(addItemToEnd_2, sum)
create_3 = List.Create(join_5)
transpose_3 = List.Transpose(create_3)
combine_2 = List.Combine(join, combine, transpose_3)
boolean = BoolSelector(false)
writeToFile = Excel.WriteToFile(filePath=string, sheetName=string_2, startRow=number, startCol=number, data=combine_2, overWrite=boolean)
uniqueItems_2 = List.UniqueItems(getParameterValueByName)
sort_2 = List.Sort(uniqueItems_2)
groupByKey = GroupByKey(getParameterValueByName, sort_2)
getParameterValueByName_11 = Element.GetParameterValueByName(parameterName=string_5)
watch = Watch(types)
getParameterValueByName_12 = Element.GetParameterValueByName(element=watch, parameterName=string_5)
