# Dynamo graph units.dyn (Dynamo 0.9.0.3067)

element_types = ElementTypes("Group")
all_elements_of_type = ElementsOfType(element_types)
watch = Watch(all_elements_of_type)
family_types = FamilyTypes("Circular Mullion:Circular Mullion 1")
element_types_2 = ElementTypes("GroupType")
all_elements_of_type_2 = ElementsOfType(element_types_2)
watch_2 = Watch(all_elements_of_type_2)
name = Element.Name(all_elements_of_type_2)
name_2 = Element.Name(all_elements_of_type)
